vi "Main.gviweb"   [LabVIEW NXG 2.0.0]
panel controls:
  "Trigger Send": bool
  "Trigger Reset": bool
panel indicators:
  "Send File": bool
  "Reset": bool
  "Available Disk": f64
  "Available Memory": f64
  "Files Sent": f64
  "Buffer": f64
  "Temp": T1
types:
  T1 = cluster{"Element 1": f64, "Element 2": f64, "Element 3": f64, "Element 4": f64}
uses:
  Application::Send Message.gviweb
  Application::Reset Aggregates.gviweb
  Application::Read Tag (Double).gviweb
diagram:
  case (TRUE) {
    frame False, Default {
      w1 = "jprewitt4"
      w2 = "josh-9068"
    }
    frame True {
      w3 = "demo.systemlink.io"  # Server
      w4 = "ni-crio-9068-190cb7b"  # Target
      w1 = w3
      w2 = w4
    }
  }
  while {
    Wait(time to wait=50)
    case ($"Trigger Send") {
      frame False, Default {
        $"Send File" <- FALSE
      }
      frame True {
        $"Send File" <- TRUE
        call "Send Message.gviweb"(Topic="send_file", Server=w1, Message="send_file")
        Wait(time to wait=500)
      }
    }
    case ($"Trigger Reset") {
      frame False, Default {
        $Reset <- FALSE
      }
      frame True {
        $Reset <- TRUE
        Concatenate Strings(w2, ".ai.", "0") -> w5
        call "Reset Aggregates.gviweb"(Server=w1, Tag=w5)
        Wait(time to wait=500)
      }
    }
    stop if FALSE
  }
  while {
    Wait(time to wait=1000)
    w6 = ["available_disk", "available_memory", "files_sent", "buffer", "ai.0"]
    for (iteration -> i1) {
      w7 = each element of w6
      Concatenate Strings(w2, ".", w7) -> w8
      case (i1) {
        frame 0, Default {
          call "Read Tag (Double).gviweb"(Server=w1, Tag=w8) -> (Value=w9)
          $"Available Disk" <- w9
        }
        frame 1 {
          call "Read Tag (Double).gviweb"(Server=w1, Tag=w8) -> (Value=w10)
          $"Available Memory" <- w10
        }
        frame 2 {
          call "Read Tag (Double).gviweb"(Server=w1, Tag=w8) -> (Value=w11)
          $"Files Sent" <- w11
        }
        frame 3 {
          call "Read Tag (Double).gviweb"(Server=w1, Tag=w8) -> (Value=w12)
          $Buffer <- w12
        }
        frame 4 {
          call "Read Tag (Double).gviweb"(Server=w1, Tag=w8) -> (Value=w13, Minimum=w14, Average=w15, Maximum=w16)
          Build Cluster(w13, w14, w15, w16) -> w17
          $Temp <- w17
        }
      }
    }
    stop if FALSE
  }
